# Grasshopper definition starling_egg.gh (Grasshopper 1.0.7)

# ---- group: Document
panel = Panel("""Lars van Vianen
Sander Boer""")
company_text = Text("Starling Associates")
path = FilePath()
authors_text = Text(panel)
description_text = Text("Starling Egg Template")
parameters_text = Text("Starling Egg Template")

# ----
pipeline = GeometryPipeline(
    GroupByLayer=False,
    GroupByType=False,
    IncludeHidden=True,
    IncludeLocked=True,
    LayerFilter="gh::center",
    NameFilter="*",
    SublayerFiltering=True,
    TypeFilter=1)
pt = Point(pipeline)

l_num = Number(Slider(6, range=0..10))
b_num = Number(Slider(4, range=0..10))
n_num = Number(Slider(1.5, range=0..10))
int = Integer(Slider(100, range=0..100))

shell_colour_col = Colour(ColourSwatch(SwatchColor=RGB(121, 212, 242)))
shell_colour_col_2 = Colour(ColourSwatch(SwatchColor=RGB(255, 255, 255)))
crack_n_int = Integer(Slider(25, range=0..100))
shell_shine_num = Number(Slider(0.5, range=0..1))
shell_shine_num_2 = Number(Slider(0, range=0..1))
crack_s_int = Integer(Slider(10, range=0..10))

# ---- group: Version
calendar = Calendar()
version = ControlKnob(Decimals=2, Limit=True, Maximum=10, Minimum=0, Range=1, Value=1)
version_num = Number(version)
date_time = Time(calendar)

# ----
l_num_2 = Number(l_num)
int_2 = Integer(int)
expression = Expression(L=l_num_2, Expression="(L / 2)")
dom = ConstructDomain(DomainStart=expr("-x", expression), DomainEnd=expression)
range = Range(Domain=dom, Steps=int_2)
x_num = Number(range)

# ---- group: Center Planes
pt_2 = Point(pt)  # disabled
xy = XYPlane(Origin=pt_2)  # disabled
xz = XZPlane(Origin=pt_2)  # disabled
yz = YZPlane(Origin=pt_2)  # disabled
pln = Plane(xy)  # disabled
pln_2 = Plane(xz)  # disabled
pln_3 = Plane(yz)  # disabled

# ----
l_num_3 = Number(l_num)
b_num_2 = Number(b_num)
n_num_2 = Number(n_num)
expression_2 = Expression(L=l_num_3, B=b_num_2, n=n_num_2, Expression="(L - B) / (2 * n)")
w_num = Number(expression_2)

# ---- group: Legend
input = ColourSwatch(SwatchColor=RGB(255, 254, 254))
input_2 = ColourSwatch(SwatchColor=RGB(255, 254, 254))
input_3 = ColourSwatch(SwatchColor=RGB(255, 254, 254))
input_4 = ColourSwatch(SwatchColor=RGB(255, 254, 254))

# ---- group: Eq. (1). Hügelschäffer's Model
b_num_3 = Number(b_num)
w_num_2 = Number(w_num)
l_num_4 = Number(l_num)
x_num_2 = Number(x_num)
# maximum egg breadth (B) to
# 
# egg length (L)
# 
# n is a positive number.
hügelschäffer_s_model = Expression(L=l_num_4, B=b_num_3, w=w_num_2, x=x_num_2, Expression="(B/2) * (SQRT((L² - 4*x²) / (L² + 8*w*x + 4*w²)))")
y_num = Number(hügelschäffer_s_model)

# ---- group: Shell
y_num_2 = Number(y_num)
x_num_3 = Number(x_num)
pt_3 = ConstructPoint(XCoordinate=0, YCoordinate=y_num_2, ZCoordinate=x_num_3)
pt_4 = ConstructPoint(XCoordinate=0, YCoordinate=0, ZCoordinate=0)
Z = UnitZ(Factor=1)
intcrv = Interpolate(Vertices=pt_3, Degree=3, Periodic=False, KnotStyle=1)  # -> Curve, Length, Domain
line = LineSDL(Start=pt_4, Direction=Z, Length=1)
revsrf = Revolution(Curve=intcrv.Curve, Axis=line, Domain=Domain(0, 6.283185307))
shell_srf = Surface(revsrf)

# ---- group: Cracks
xy_2 = XYPlane(Origin=Point(0, 0, 0))
shell_srf_2 = Surface(shell_srf)
crack_n_int_2 = Integer(crack_n_int)
crack_s_int_2 = Integer(crack_s_int)
popgeo = PopulateGeometry(Geometry=shell_srf_2, Count=crack_n_int_2, Seed=crack_s_int_2)
bbox = BoundingBox(Content=shell_srf_2, Plane=xy_2)  # -> Box, Box_2
voronoi³ = Voronoi3D(Points=popgeo, Box=bbox.Box)  # -> Cells, Boundary
bbx = BrepBrep(BrepA=shell_srf_2, BrepB=voronoi³.Cells)  # -> simplify(Curves), Points
cracks_crv = Curve(bbx.Curves)
pt_5 = Point(popgeo)

# ----
pt_6 = Point(pt_5)

cracks_crv_2 = Curve(cracks_crv)
shell_srf_3 = Surface(shell_srf)
pdecon = Deconstruct(Point=pt_6)  # -> XComponent, YComponent, ZComponent
pt_7 = ConstructPoint(XCoordinate=pdecon.XComponent, YCoordinate=pdecon.YComponent, ZCoordinate=0)
vec = VectorXYZ(XComponent=pdecon.XComponent, YComponent=pdecon.YComponent, ZComponent=0)  # -> Vector, Length
rev = Reverse(Vector=vec.Vector)
rotate = RotateDirection(Geometry=shell_srf_3, Center=Point(0, 0, 0), From=Vector(1, 0, 0), To=rev)  # -> Geometry, Transform
srfsplit = SurfaceSplit(Surface=graft(rotate.Geometry), Curves=cracks_crv_2)  # -> simplify(Fragments)
area = Area(Geometry=srfsplit)  # -> Area, Centroid
sort = SortList(Keys=area.Area, ValuesA=srfsplit)  # -> Keys, ValuesA
item = ListItem(List=sort.ValuesA, Index=0, Wrap=True)
srf = Surface(item)

vec_2 = Vector(vec.Vector)
num = Number(Slider(0.2, range=0..1))

pt_8 = ConstructPoint(XCoordinate=0, YCoordinate=0, ZCoordinate=0)
srf_2 = Surface(srf)
num_2 = Number(num)
pt_9 = Point(pt_5)
vec2pt = Vector2Pt(PointA=pt_8, PointB=pt_9, Unitize=False)  # -> Vector, Length
amp = Amplitude(Vector=vec2pt.Vector, Amplitude=num_2)
move = Move(Geometry=flatten(srf_2), Motion=amp)  # -> simplify(Geometry), Transform
rulesrf = RuledSurface(CurveA=flatten(srf_2), CurveB=move.Geometry)
merge = Merge(Data1=simplify(srf_2), Data2=simplify(graft(rulesrf)), Data3=simplify(graft(move.Geometry)))
join = BrepJoin(Breps=merge)  # -> Breps, Closed
brep = Brep(join.Breps)

brep_2 = Brep(brep)
int_3 = Integer(Slider(25, range=0..100))
int_4 = Integer(int_3)
cull_i = CullIndex(List=flatten(brep_2), Indices=int_4, Wrap=True)
item_2 = ListItem(List=flatten(brep_2), Index=int_4, Wrap=True)
brep_3 = Brep(cull_i)
cracks_crv_3 = Curve(cracks_crv)
brep_4 = Brep(brep_3)

shell_shine_num_3 = Number(shell_shine_num)
shell_srf_4 = Surface(brep_4)
shell_colour_col_3 = Colour(shell_colour_col)
material = CreateMaterial(Diffuse=shell_colour_col_3, Specular=RGB(255, 254, 254), Emission=RGB(0, 0, 0), Transparency=0, Shine=shell_shine_num_3)
preview = CustomPreview(Geometry=brep_4, Material=material)

crack_shine_num = Number(shell_shine_num_2)
crack_colour_col = Colour(shell_colour_col_2)
material_2 = CreateMaterial(Diffuse=crack_colour_col, Specular=RGB(255, 254, 254), Emission=RGB(0, 0, 0), Transparency=0, Shine=crack_shine_num)
preview_2 = CustomPreview(Geometry=cracks_crv_3, Material=material_2)
